# Dynamo graph ovv_script.dyn "NADPISYWANIE WIDOCZNOŚCI ELEMENTU" (Dynamo 2.6.1.8786)

categories = Categories("OST_MechanicalEquipment")  # graph input
views = Views("Section 63")  # graph input
all_elements_of_category_in_view = ElementsOfCategoryInView(Category=categories, View=views)
name = Element.Name(element=all_elements_of_category_in_view)
type_name = StringInput("ECO_ELEKTRYCZNY")  # graph input
contains = String.Contains(str=name, searchFor=type_name)
filterByBoolMask = List.FilterByBoolMask(list=all_elements_of_category_in_view, mask=contains)
set_new_colour_or_set_no = BoolSelector(false)  # graph input
A = DoubleSlider(137, range=0..1000 step 1)  # graph input
R = DoubleSlider(72, range=0..1000 step 1)  # graph input
G = DoubleSlider(33, range=0..1000 step 1)  # graph input
B = DoubleSlider(38, range=0..1000 step 1)  # graph input
byARGB = Color.ByARGB(a=A, r=R, g=G, b=B)
byProperties = Revit.Filter.OverrideGraphicSettings.ByProperties(projectionLineColor=byARGB)
byProperties_2 = Revit.Filter.OverrideGraphicSettings.ByProperties()
if_ = If(test=set_new_colour_or_set_no, true=byProperties, false=byProperties_2)
overrideInView = Element.OverrideInView(element=filterByBoolMask.out, overrides=if_)
watch = Watch(overrideInView)
